# Grasshopper definition 240529_Geometry Generator.gh (Grasshopper 1.0.8)
# plug-ins: jSwan, RhinoCodePluginGH, Pufferfish, Ariadne, Kangaroo2 Components

pipeline = GeometryPipeline(
    GroupByLayer=False,
    GroupByType=False,
    IncludeHidden=True,
    IncludeLocked=True,
    LayerFilter="Default",
    NameFilter="*",
    SublayerFiltering=True,
    TypeFilter=4)
pipeline_2 = GeometryPipeline(
    GroupByLayer=False,
    GroupByType=False,
    IncludeHidden=True,
    IncludeLocked=True,
    LayerFilter="Default",
    NameFilter="*",
    SublayerFiltering=True,
    TypeFilter=1)
crv = Curve([<curve referenced from the Rhino model> x28])
number_slider = Slider(10, range=0..10)
number_slider_2 = Slider(12, range=0..100)
pt = Point([<point referenced from the Rhino model> x9])
mcx = MultipleCurves(Curves=crv)  # -> Points, IndexA, IndexB, ParamA, ParamB
listdexs = ListIndices(List=crv)
difference = SetDifference(SetA=listdexs, SetB=flatten([mcx.IndexA, mcx.IndexB]))
py3 = Python3Script(iA=mcx.IndexA, iB=mcx.IndexB, tA=mcx.ParamA, tB=mcx.ParamB, crvs=crv)  # -> out, shattered; inputs iA: list of Int32, iB: list of Int32, tA: list of Double, tB: list of Double, crvs: list of Curve
# ---------- py3: Python ----------
import Rhino.Geometry as rg

shattered = []

for i in range(len(crvs)):
    shatter_params = []
    for j in range(len(iA)):
        if iA[j] == i:
            shatter_params.append(tA[j])
    for j in range(len(iB)):
        if iB[j] == i:
            shatter_params.append(tB[j])

    shattered.extend(crvs[i].Split(shatter_params))
# ---------- end py3 ----------
dom = ConstructDomain(DomainStart="0", DomainEnd=number_slider)
dom_2 = ConstructDomain(DomainStart="0", DomainEnd=number_slider_2)
xy = XYPlane(Origin=Point(0, 0, 0))
item = ListItem(List=crv, Index=difference, Wrap=True)
rectangle = Rectangle(Plane=xy, XSize=dom_2, YSize=dom, Radius=0)  # -> Rectangle, Length
explode = Explode(Curve=rectangle.Rectangle, Recursive=True)  # -> Segments, Vertices
area = Area(Geometry=rectangle.Rectangle)  # -> Area, Centroid
cull_i = CullIndex(List=explode.Vertices, Indices=0, Wrap=True)
item_2 = ListItem(List=explode.Segments, Index=0, Wrap=True)  # -> Item, Item1, Item2, Item3
explode_2 = Explode(Curve=py3.shattered, Recursive=True)  # -> flatten(Segments), flatten(Vertices)
midpt = CurveMiddle(Curve=explode.Segments)  # -> graft(Midpoint)
item_3 = ListItem(List=explode.Vertices, Index=0, Wrap=True)  # -> Item, Item1, Item2, Item3
dupln = RemoveDuplicateLines(Lines=flatten([explode_2.Segments, item]), Tolerance=0.01)

ln = Line(StartPoint=area.Centroid, EndPoint=midpt)
eval = EvaluateCurve(Curve=reparameterize(ln), Parameter=Slider(0, range=0..1))  # -> Point, Tangent, Angle
shift = ShiftList(List=cull_i, Shift=-1, Wrap=True)  # -> simplify(List)
pline = PolyLine(Vertices=flatten(eval.Point), Closed=True)
ln_2 = Line(StartPoint=graft(shift), EndPoint=eval.Point)
ln_3 = Line(StartPoint=graft(cull_i), EndPoint=eval.Point)
crv_2 = Curve(flatten([ln_3, ln_2, pline, explode.Segments]))

duppt = RemoveDuplicatePts(Points=explode_2.Vertices, Tolerance=0.01)

ln_4 = Line(StartPoint=area.Centroid, EndPoint=graft([item_3.Item, item_3.Item1, item_3.Item2, item_3.Item3]))
shift_2 = ShiftList(List=flatten(midpt), Shift=-1, Wrap=True)  # -> graft(List)
eval_2 = EvaluateCurve(Curve=reparameterize(ln_4), Parameter=Slider(0.449, range=0..1))  # -> Point, Tangent, Angle
ln_5 = Line(StartPoint=shift_2, EndPoint=eval_2.Point)
ln_6 = Line(StartPoint=midpt, EndPoint=eval_2.Point)
line = Line(flatten([ln_6, ln_5, ln_4, explode.Segments]))

number_slider_3 = Slider(0, range=0..1)
shift_3 = ShiftList(List=flatten(ln_5), Shift=1, Wrap=True)  # -> simplify(graft(List))
pt_2 = Point(simplify(graft(cull_i)))
eval_3 = EvaluateCurve(Curve=ln_6, Parameter=number_slider_3)  # -> simplify(Point), Tangent, Angle
shift_4 = ShiftList(List=cull_i, Shift=-1, Wrap=True)  # -> simplify(graft(List))
eval_4 = EvaluateCurve(Curve=shift_3, Parameter=number_slider_3)  # -> simplify(Point), Tangent, Angle
merge = Merge(Data1=shift_4, Data2=eval_3.Point, Data3=eval_4.Point, Data4=pt_2)
pline_2 = PolyLine(Vertices=merge, Closed=False)
crv_3 = Curve([pline_2, line])

clean = CleanTree(RemoveNulls=True, RemoveInvalid=True, RemoveEmpty=False, Tree=dupln)
clean_2 = CleanTree(RemoveNulls=True, RemoveInvalid=True, RemoveEmpty=False, Tree=duppt)
py3_2 = Python3Script(lines=clean, vertices=clean_2, columns=pt)  # -> out, simplify(positions), simplify(connectivities), simplify(column_i); inputs lines: list of Line, vertices: list of Point3d, columns: list of Point3d
# ---------- py3_2: Python ----------
import Rhino.Geometry as rg
import ghpythonlib.treehelpers as th

positions = []

for i in range(len(vertices)):
    vertex = vertices[i]
    positions.append([vertex.X,vertex.Y,0])

connectivities = []
tol = 1e-3

for i in range(len(lines)):
    line = lines[i]
    connectivity = []
    for j in range(len(positions)):
        if (abs(line.From[0] - positions[j][0]) < tol and abs(line.From[1] - positions[j][1]) < tol):
            connectivity.append(j+1)
        elif (abs(line.To[0] - positions[j][0]) < tol and abs(line.To[1] - positions[j][1]) < tol):
            connectivity.append(j+1)
    if len(connectivity) > 1:
        connectivities.append(connectivity)

if columns != None:
    column_i = []
    for i in range(len(columns)):
        for j in range(len(positions)):
            if (abs(columns[i].X - positions[j][0]) < tol and abs(columns[i].Y - positions[j][1]) < tol):
                column_i.append(j+1)

positions = th.list_to_tree(positions)
connectivities = th.list_to_tree(connectivities)
column_i = th.list_to_tree(column_i)
# ---------- end py3_2 ----------
num = Number(py3_2.positions)
num_2 = Number(py3_2.column_i)
num_3 = Number(py3_2.connectivities)
panel = Panel("""from
to""")
panel_2 = Panel("""x
y
z""")
rejsonkv = SerializeKeysAndValues(Key=panel, Value=num_3)  # -> flatten(JSON)
rejsonkv_2 = SerializeKeysAndValues(Key=panel_2, Value=num)  # -> flatten(JSON)
rejsonkv_3 = SerializeKeysAndValues(Key="positions", Value=rejsonkv_2)
rejsonkv_4 = SerializeKeysAndValues(Key="columns_i", Value=num_2)
rejsonkv_5 = SerializeKeysAndValues(Key="connectivities", Value=rejsonkv)
jmerge = MergeJson(SourceJson=rejsonkv_3, OverrideJson=rejsonkv_5)
jmerge_2 = MergeJson(SourceJson=jmerge, OverrideJson=rejsonkv_4)

# ---- group: save as json!
panel_3 = Panel("/Users/tashahirt/Dropbox (MIT)/_MIT/Digital Structures Research/Tributary Areas/revised_jsons")
row = Slider(1, range=1..10)
col = Slider(1, range=1..10)
concat = Concatenate(FragmentA="r", FragmentB=row, FragmentC="c", FragmentD=col)
py3_3 = Python3Script(content=jmerge_2, folder=panel_3, filename=concat, dump=Button())  # -> out, a; inputs content: String, folder: String, filename: String, dump: Boolean
# ---------- py3_3: Python ----------
import json
import Grasshopper as gh

destination = folder + "/" + filename + ".json"

if dump:
    f = open(destination, "w")
    json.dump(content,f)
    f.close()
# ---------- end py3_3 ----------

# ----
panel_4 = Panel(jmerge_2)
update = Button()
panel_5 = Panel("2000")
start = Start(Host="127.0.0.1", Port="2000", Reset=Button(), Message="init")
send = Send(WebSocketObject=start, Update=update, Message=jmerge_2)
receive = Receive(WebSocketObject=start, Update=Toggle(True))
dejson = DeserializeJson(JSON=receive, OutputsLocked=False)
ma = MassAddition(Input=dejson)  # -> Result, PartialResults

number_slider_4 = Slider(0, range=0..10)
number_slider_5 = Slider(3, range=0..10)

num_4 = Number(number_slider_4)
num_5 = Number(number_slider_4)

divide = DivideCurve(Curve=item_2.Item, Count=num_5, Kinks=False)  # -> Points, Tangents, Parameters
divide_2 = DivideCurve(Curve=item_2.Item2, Count=num_5, Kinks=False)  # -> reverse(Points), Tangents, Parameters
divide_3 = DivideCurve(Curve=item_2.Item1, Count=num_4, Kinks=False)  # -> Points, Tangents, Parameters
divide_4 = DivideCurve(Curve=item_2.Item3, Count=num_4, Kinks=False)  # -> reverse(Points), Tangents, Parameters
ln_7 = Line(StartPoint=divide.Points, EndPoint=divide_2.Points)
ln_8 = Line(StartPoint=divide_3.Points, EndPoint=divide_4.Points)
line_2 = Line(flatten([ln_7, ln_8, explode.Segments]))

Y = UnitY(Factor=number_slider)
X = UnitX(Factor=number_slider_2)
move = Move(Geometry=line_2, Motion=X)  # -> Geometry, Transform
move_2 = Move(Geometry=[move.Geometry, line_2], Motion=Y)  # -> Geometry, Transform
crv_4 = Curve([move_2.Geometry, move.Geometry, line_2])
