# Grasshopper definition 240709_Geometry Generator.gh (Grasshopper 1.0.8)
# plug-ins: jSwan, RhinoCodePluginGH, Pufferfish, Ariadne, Kangaroo2 Components

pipeline = GeometryPipeline(
    GroupByLayer=False,
    GroupByType=False,
    IncludeHidden=True,
    IncludeLocked=True,
    LayerFilter="Layer 04",
    NameFilter="*",
    SublayerFiltering=True,
    TypeFilter=4)
pipeline_2 = GeometryPipeline(
    GroupByLayer=False,
    GroupByType=False,
    IncludeHidden=True,
    IncludeLocked=True,
    LayerFilter="Layer 04",
    NameFilter="*",
    SublayerFiltering=True,
    TypeFilter=1)
number_slider = Slider(10, range=0..10)
number_slider_2 = Slider(12, range=0..100)
pt = Point(pipeline_2)
crv = Curve(pipeline)
c = Slider(6, range=1..6)
e = Slider(6, range=1..6)
mcx = MultipleCurves(Curves=crv)  # -> Points, IndexA, IndexB, ParamA, ParamB
listdexs = ListIndices(List=crv)
difference = SetDifference(SetA=listdexs, SetB=flatten([mcx.IndexA, mcx.IndexB]))
py3 = Python3Script(iA=mcx.IndexA, iB=mcx.IndexB, tA=mcx.ParamA, tB=mcx.ParamB, crvs=crv)  # -> out, shattered, beam_group; inputs iA: list of Int32, iB: list of Int32, tA: list of Double, tB: list of Double, crvs: list of Curve
# ---------- py3: Python ----------
import Rhino.Geometry as rg

shattered = []
beam_group = []

for i in range(len(crvs)):
    shatter_params = []
    for j in range(len(iA)):
        if iA[j] == i:
            shatter_params.append(tA[j])
    for j in range(len(iB)):
        if iB[j] == i:
            shatter_params.append(tB[j])

    split_curves = crvs[i].Split(shatter_params)
    shattered.extend(split_curves)
    beam_group.extend([i+1] * len(split_curves))
# ---------- end py3 ----------
dom = ConstructDomain(DomainStart="0", DomainEnd=number_slider)
dom_2 = ConstructDomain(DomainStart="0", DomainEnd=number_slider_2)
xy = XYPlane(Origin=Point(0, 0, 0))
item = ListItem(List=crv, Index=difference, Wrap=True)
one_over_x = OneOverX(Value=c)
one_over_x_2 = OneOverX(Value=e)
rectangle = Rectangle(Plane=xy, XSize=dom_2, YSize=dom, Radius=0)  # -> Rectangle, Length
explode = Explode(Curve=py3.shattered, Recursive=True)  # -> flatten(Segments), flatten(Vertices)
explode_2 = Explode(Curve=rectangle.Rectangle, Recursive=True)  # -> Segments, Vertices
area = Area(Geometry=rectangle.Rectangle)  # -> Area, Centroid
cull_i = CullIndex(List=explode_2.Vertices, Indices=0, Wrap=True)
item_2 = ListItem(List=explode_2.Segments, Index=0, Wrap=True)  # -> Item, Item1, Item2, Item3
series = Series(Start=0, Step=one_over_x, Count=c)
series_2 = Series(Start=0, Step=one_over_x_2, Count=e)
midpt = CurveMiddle(Curve=explode_2.Segments)  # -> graft(Midpoint)
item_3 = ListItem(List=explode_2.Vertices, Index=0, Wrap=True)  # -> Item, Item1, Item2, Item3

midpt_2 = CurveMiddle(Curve=explode_2.Segments)  # -> graft(Midpoint)
avr = Average(Input=flatten(midpt_2))
ln = Line(StartPoint=midpt_2, EndPoint=avr)
item_4 = ListItem(List=flatten(ln), Index=0, Wrap=True)
item_5 = ListItem(List=flatten(ln), Index=0, Wrap=True)  # -> Item, Item1, Item2, Item3
pt_2 = Point(item_3.Item)
eval = EvaluateCurve(Curve=graft([item_5.Item, item_5.Item3]), Parameter=series)  # -> Point, Tangent, Angle
ln_2 = Line(StartPoint=pt_2, EndPoint=eval.Point)  # -> flatten(Line)
mirror = MirrorCurve(Geometry=ln_2, Curve=item_5.Item, Tangent=True)
mirror_2 = MirrorCurve(Geometry=[mirror, ln_2], Curve=item_5.Item1, Tangent=True)
line = Line([ln_2, mirror, mirror_2])

number_slider_3 = Slider(172, range=0..205)
dupln = RemoveDuplicateLines(Lines=flatten([explode.Segments, item]), Tolerance=0.01)

ln_3 = Line(StartPoint=area.Centroid, EndPoint=midpt)
eval_2 = EvaluateCurve(Curve=reparameterize(ln_3), Parameter=Slider(0, range=0..1))  # -> Point, Tangent, Angle
shift = ShiftList(List=cull_i, Shift=-1, Wrap=True)  # -> simplify(List)
pline = PolyLine(Vertices=flatten(eval_2.Point), Closed=True)
ln_4 = Line(StartPoint=graft(shift), EndPoint=eval_2.Point)
ln_5 = Line(StartPoint=graft(cull_i), EndPoint=eval_2.Point)
crv_2 = Curve(flatten([ln_5, ln_4, pline, explode_2.Segments]))

duppt = RemoveDuplicatePts(Points=explode.Vertices, Tolerance=0.01)

ln_6 = Line(StartPoint=area.Centroid, EndPoint=graft([item_3.Item, item_3.Item1, item_3.Item2, item_3.Item3]))
shift_2 = ShiftList(List=flatten(midpt), Shift=-1, Wrap=True)  # -> graft(List)
eval_3 = EvaluateCurve(Curve=reparameterize(ln_6), Parameter=Slider(0.339, range=0..1))  # -> Point, Tangent, Angle
ln_7 = Line(StartPoint=shift_2, EndPoint=eval_3.Point)
ln_8 = Line(StartPoint=midpt, EndPoint=eval_3.Point)
line_2 = Line(flatten([ln_8, ln_7, ln_6, explode_2.Segments]))

number_slider_4 = Slider(0.49, range=0..1)
shift_3 = ShiftList(List=flatten(ln_7), Shift=1, Wrap=True)  # -> simplify(graft(List))
pt_3 = Point(simplify(graft(cull_i)))
eval_4 = EvaluateCurve(Curve=ln_8, Parameter=number_slider_4)  # -> simplify(Point), Tangent, Angle
shift_4 = ShiftList(List=cull_i, Shift=-1, Wrap=True)  # -> simplify(graft(List))
eval_5 = EvaluateCurve(Curve=shift_3, Parameter=number_slider_4)  # -> simplify(Point), Tangent, Angle
merge = Merge(Data1=shift_4, Data2=eval_4.Point, Data3=eval_5.Point, Data4=pt_3)
pline_2 = PolyLine(Vertices=merge, Closed=False)
crv_3 = Curve([pline_2, line_2])

ln_9 = Line(StartPoint=area.Centroid, EndPoint=graft([item_3.Item, item_3.Item1, item_3.Item2, item_3.Item3]))
shift_5 = ShiftList(List=flatten(midpt), Shift=-1, Wrap=True)  # -> graft(List)
eval_6 = EvaluateCurve(Curve=reparameterize(ln_9), Parameter=series_2)  # -> Point, Tangent, Angle
ln_10 = Line(StartPoint=shift_5, EndPoint=eval_6.Point)
ln_11 = Line(StartPoint=midpt, EndPoint=eval_6.Point)
line_3 = Line(flatten([ln_11, ln_10, ln_9, explode_2.Segments]))

clean = CleanTree(RemoveNulls=True, RemoveInvalid=True, RemoveEmpty=False, Tree=dupln)
split = SplitList(List=clean, Index=number_slider_3)  # -> ListA, ListB
clean_2 = CleanTree(RemoveNulls=True, RemoveInvalid=True, RemoveEmpty=False, Tree=duppt)
crv_4 = Curve(split.ListB)
py3_2 = Python3Script(lines=clean, line_id=py3.beam_group, vertices=clean_2, columns=pt)  # -> out, simplify(positions), simplify(connectivities), simplify(column_i); inputs lines: list of Line, line_id: list, vertices: list of Point3d, columns: list of Point3d
# ---------- py3_2: Python ----------
import Rhino.Geometry as rg
import ghpythonlib.treehelpers as th

positions = []

for i in range(len(vertices)):
    vertex = vertices[i]
    positions.append([vertex.X,vertex.Y,0])

connectivities = []
tol = 1e-3

for i in range(len(lines)):
    line = lines[i]
    connectivity = []
    for j in range(len(positions)):
        if (abs(line.From[0] - positions[j][0]) < tol and abs(line.From[1] - positions[j][1]) < tol):
            connectivity.append(j+1)
        elif (abs(line.To[0] - positions[j][0]) < tol and abs(line.To[1] - positions[j][1]) < tol):
            connectivity.append(j+1)
    if len(connectivity) > 1:
        connectivity.append(line_id[i])
        connectivities.append(connectivity)

if columns != None:
    column_i = []
    for i in range(len(columns)):
        for j in range(len(positions)):
            if (abs(columns[i].X - positions[j][0]) < tol and abs(columns[i].Y - positions[j][1]) < tol):
                column_i.append(j+1)

positions = th.list_to_tree(positions)
connectivities = th.list_to_tree(connectivities)
column_i = th.list_to_tree(column_i)
# ---------- end py3_2 ----------
item_6 = ListItem(List=clean, Index=number_slider_3, Wrap=True)
num = Number(py3_2.positions)
num_2 = Number(py3_2.connectivities)
num_3 = Number(py3_2.column_i)
crv_5 = Curve([<curve referenced from the Rhino model> x32])
panel = Panel("""from
to
id""")
panel_2 = Panel("""x
y
z""")
len = Length(Curve=crv_5)
rejsonkv = SerializeKeysAndValues(Key=panel, Value=num_2)  # -> flatten(JSON)
rejsonkv_2 = SerializeKeysAndValues(Key=panel_2, Value=num)  # -> flatten(JSON)
line_4 = Line(flatten([line_3, line]))
sort = SortList(Keys=len)  # -> Keys, ValuesA
rejsonkv_3 = SerializeKeysAndValues(Key="positions", Value=rejsonkv_2)
rejsonkv_4 = SerializeKeysAndValues(Key="columns_i", Value=num_3)
rejsonkv_5 = SerializeKeysAndValues(Key="connectivities", Value=rejsonkv)
jmerge = MergeJson(SourceJson=rejsonkv_3, OverrideJson=rejsonkv_5)

Y = UnitY(Factor=number_slider)
X = UnitX(Factor=number_slider_2)
move = Move(Geometry=line_4, Motion=X)  # -> Geometry, Transform
move_2 = Move(Geometry=[move.Geometry, line_4], Motion=Y)  # -> Geometry, Transform
crv_6 = Curve([move_2.Geometry, move.Geometry, line_4])

jmerge_2 = MergeJson(SourceJson=jmerge, OverrideJson=rejsonkv_4)

# ---- group: save as json!
panel_3 = Panel("/Users/tashahirt/Dropbox (MIT)/_MIT/Digital Structures Research/Tributary Areas/_special_jsons/")
row = Slider(6, range=1..10)
col = Slider(4, range=1..10)
concat = Concatenate(FragmentA="e", FragmentB=row, FragmentC="c", FragmentD=col)
py3_3 = Python3Script(content=jmerge_2, folder=panel_3, filename="s6-6_drawn_reduced", dump=Button())  # -> out, a; inputs content: String, folder: String, filename: String, dump: Boolean
# ---------- py3_3: Python ----------
import json
import Grasshopper as gh

destination = folder + "/" + filename + ".json"

if dump:
    f = open(destination, "w")
    json.dump(content,f)
    f.close()
# ---------- end py3_3 ----------

# ----
panel_4 = Panel(jmerge_2)
update = Button()
Y_2 = UnitY(Factor="-20")
panel_5 = Panel("2000")
move_3 = Move(Geometry=crv_6, Motion=Y_2)  # -> Geometry, Transform
start = Start(Host="127.0.0.1", Port="2000", Reset=Button(), Message="init")
send = Send(WebSocketObject=start, Update=update, Message=jmerge_2)
receive = Receive(WebSocketObject=start, Update=Toggle(True))
dejson = DeserializeJson(JSON=receive, OutputsLocked=False)
ma = MassAddition(Input=dejson)  # -> Result, PartialResults
num_4 = Number(Slider(10, range=0..10))
num_5 = Number(Slider(10, range=0..10))

divide = DivideCurve(Curve=item_2.Item, Count=num_5, Kinks=False)  # -> Points, Tangents, Parameters
divide_2 = DivideCurve(Curve=item_2.Item2, Count=num_5, Kinks=False)  # -> reverse(Points), Tangents, Parameters
divide_3 = DivideCurve(Curve=item_2.Item1, Count=num_4, Kinks=False)  # -> Points, Tangents, Parameters
divide_4 = DivideCurve(Curve=item_2.Item3, Count=num_4, Kinks=False)  # -> reverse(Points), Tangents, Parameters
ln_12 = Line(StartPoint=divide.Points, EndPoint=divide_2.Points)
ln_13 = Line(StartPoint=divide_3.Points, EndPoint=divide_4.Points)
line_5 = Line(flatten([ln_12, ln_13, explode_2.Segments]))
