# Grasshopper definition 240903_Geo Generator Drawn.gh (Grasshopper 1.0.8)
# plug-ins: RhinoCodePluginGH

pipeline = GeometryPipeline(
    GroupByLayer=False,
    GroupByType=False,
    IncludeHidden=True,
    IncludeLocked=True,
    LayerFilter="Layer 03",
    NameFilter="*",
    SublayerFiltering=True,
    TypeFilter=1)
pipeline_2 = GeometryPipeline(
    GroupByLayer=False,
    GroupByType=False,
    IncludeHidden=True,
    IncludeLocked=True,
    LayerFilter="Layer 03",
    NameFilter="*",
    SublayerFiltering=True,
    TypeFilter=4)
pt = Point(pipeline)
mcx = MultipleCurves(Curves=pipeline_2)  # -> Points, IndexA, IndexB, ParamA, ParamB
py3 = Python3Script(iA=mcx.IndexA, iB=mcx.IndexB, tA=mcx.ParamA, tB=mcx.ParamB, crvs=pipeline_2)  # -> out, shattered, beam_group; inputs iA: list of Int32, iB: list of Int32, tA: list of Double, tB: list of Double, crvs: list of Curve
# ---------- py3: Python ----------
import Rhino.Geometry as rg

shattered = []
beam_group = []

for i in range(len(crvs)):
    shatter_params = []
    for j in range(len(iA)):
        if iA[j] == i:
            shatter_params.append(tA[j])
    for j in range(len(iB)):
        if iB[j] == i:
            shatter_params.append(tB[j])

    split_curves = crvs[i].Split(shatter_params)
    shattered.extend(split_curves)
    beam_group.extend([i] * len(split_curves))
# ---------- end py3 ----------
