# Grasshopper definition 240903_Geometry Section Assignment.gh (Grasshopper 1.0.8)
# plug-ins: Pufferfish

pipeline = GeometryPipeline(
    GroupByLayer=False,
    GroupByType=False,
    IncludeHidden=True,
    IncludeLocked=True,
    LayerFilter="Steel Frame Sized::Curves::W18X35",
    NameFilter="*",
    SublayerFiltering=True,
    TypeFilter=4)
pipeline_2 = GeometryPipeline(
    GroupByLayer=False,
    GroupByType=False,
    IncludeHidden=True,
    IncludeLocked=True,
    LayerFilter="Steel Frame Sized::Curves::W10X12",
    NameFilter="*",
    SublayerFiltering=True,
    TypeFilter=4)
pipeline_3 = GeometryPipeline(
    GroupByLayer=False,
    GroupByType=False,
    IncludeHidden=True,
    IncludeLocked=True,
    LayerFilter="Steel Frame Sized::Curves::W12X19",
    NameFilter="*",
    SublayerFiltering=True,
    TypeFilter=4)
pipeline_4 = GeometryPipeline(
    GroupByLayer=False,
    GroupByType=False,
    IncludeHidden=True,
    IncludeLocked=True,
    LayerFilter="Steel Frame Sized::Curves::W16X26",
    NameFilter="*",
    SublayerFiltering=True,
    TypeFilter=4)
pipeline_5 = GeometryPipeline(
    GroupByLayer=False,
    GroupByType=False,
    IncludeHidden=True,
    IncludeLocked=True,
    LayerFilter="Steel Frame Sized::Curves::W14X22",
    NameFilter="*",
    SublayerFiltering=True,
    TypeFilter=4)
pipeline_6 = GeometryPipeline(
    GroupByLayer=False,
    GroupByType=False,
    IncludeHidden=True,
    IncludeLocked=True,
    LayerFilter="Steel Frame Sized::Curves::W6X8.5",
    NameFilter="*",
    SublayerFiltering=True,
    TypeFilter=4)
pipeline_7 = GeometryPipeline(
    GroupByLayer=False,
    GroupByType=False,
    IncludeHidden=True,
    IncludeLocked=True,
    LayerFilter="Steel Frame Sized::Curves::W8X10",
    NameFilter="*",
    SublayerFiltering=True,
    TypeFilter=4)
pipeline_8 = GeometryPipeline(
    GroupByLayer=False,
    GroupByType=False,
    IncludeHidden=True,
    IncludeLocked=True,
    LayerFilter="Steel Frame Sized::Curves::W6X9",
    NameFilter="*",
    SublayerFiltering=True,
    TypeFilter=4)
list = ValueList({"W6X8.5": 0, "W8X10": 1, "W18X35": 2, "W10X12": 3, "W12X19": 4, "W16X26": 5, "W14X22": 6, "W6X9": 7}, selected="W6X8.5")
w18x35 = Curve(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)
w16x26 = Curve(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)
w10x12 = Curve(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)
w12x19 = Curve(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)
w14x22 = Curve(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)
w8x10 = Curve(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)
w6x9 = Curve(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)
w6x8_5 = Curve(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)
filter = StreamFilter(
    Gate=list,
    Stream0=w6x8_5,
    Stream1=w8x10,
    Stream2=w18x35,
    Stream3=w10x12,
    Stream4=w12x19,
    Stream5=w16x26,
    Stream6=w14x22,
    Stream7=w6x9)
filter_2 = StreamFilter(
    Gate=list,
    Stream0=pipeline_6,
    Stream1=pipeline_7,
    Stream2=pipeline,
    Stream3=pipeline_2,
    Stream4=pipeline_3,
    Stream5=pipeline_4,
    Stream6=pipeline_5,
    Stream7=pipeline_8)
brec = BoundingRectangle(Geometry=filter, Plane=PlaneXY(0, 0, 0), Axis=0, Slide=0, Union=True)  # -> Bounding, DimensionX, DimensionY
explode = Explode(Curve=brec.Bounding, Recursive=True)  # -> Segments, Vertices
item = ListItem(List=explode.Segments, Index=2, Wrap=True)
midpt = CurveMiddle(Curve=item)
yz = YZPlane(Origin=midpt)
deplane = DeconstructPlane(Plane=yz)  # -> Origin, XAxis, YAxis, ZAxis
end = EndPoints(Curve=filter_2)  # -> Start, End
rotate = Rotate(Geometry=filter, Angle=1.570796327, Plane=yz)  # -> Geometry, Transform
pframe = PerpFrame(Curve=filter_2, Parameter="0")
vec2pt = Vector2Pt(PointA=end.Start, PointB=end.End, Unitize=False)  # -> Vector, Length
move2pt = MoveToPoint(Geometry=rotate.Geometry, PointA=midpt, PointB=end.Start)  # -> Moved, Vector, Transform
angle = Angle(VectorA=deplane.XAxis, VectorB=vec2pt.Vector)  # -> Angle, Reflex
Z = UnitZ(Factor=1)
rot3d = Rotate3D(Geometry=move2pt.Moved, Angle=angle.Angle, Center=end.Start, Axis=Z)  # -> Geometry, Transform
rot3d_2 = Rotate3D(Geometry=move2pt.Moved, Angle=angle.Reflex, Center=end.Start, Axis=Z)  # -> Geometry, Transform
swp1 = Sweep1(Rail=graft(filter_2), Sections=graft(rot3d.Geometry), Miter=1)  # -> flatten(Brep)
swp1_2 = Sweep1(Rail=graft(filter_2), Sections=graft(rot3d_2.Geometry), Miter=1)  # -> flatten(Brep)
volume = Volume(Geometry=swp1)  # -> Volume, Centroid
volume_2 = Volume(Geometry=swp1_2)  # -> Volume, Centroid
larger = LargerThan(FirstNumber=volume.Volume, SecondNumber=volume_2.Volume)  # -> LargerThan, OrEqualTo
p_n_c = PickNChoose(Pattern=larger.LargerThan, Stream0=swp1_2, Stream1=swp1)
geo = Geometry(p_n_c)
