# Grasshopper definition 240715_Pipe a Profile.gh (Grasshopper 1.0.8)

geo = Geometry([<curve referenced from the Rhino model> x53, <point referenced from the Rhino model> x8, <curve referenced from the Rhino model> x4, <point referenced from the Rhino model>])
crv = Curve(geo)
crv_2 = Curve([<curve referenced from the Rhino model> x9])
clean = CleanTree(RemoveNulls=True, RemoveInvalid=True, RemoveEmpty=False, Tree=crv)
pipe = Pipe(Curve=crv_2, Radius=Slider(0.1, range=0..0.1), Caps=0)
explode = Explode(Curve=clean, Recursive=True)  # -> flatten(Segments), Vertices
cap = CapHoles(Brep=pipe)  # -> flatten(Brep)
crv_3 = Curve(<curve referenced from the Rhino model>)
pt = Point(<point referenced from the Rhino model>)
line = Line(explode.Segments)
Y = UnitY(Factor=1)
end = EndPoints(Curve=line)  # -> Start, End
vec = Vector(line)
vec2pt = Vector2Pt(PointA=pt, PointB=end.Start, Unitize=False)  # -> Vector, Length
angle = Angle(VectorA=Y, VectorB=vec)  # -> Angle, Reflex
rotate = Rotate(Geometry=crv_3, Angle=angle.Angle, Plane=pt)  # -> Geometry, Transform
rotate_2 = Rotate(Geometry=crv_3, Angle=angle.Reflex, Plane=pt)  # -> Geometry, Transform
move = Move(Geometry=rotate_2.Geometry, Motion=vec2pt.Vector)  # -> Geometry, Transform
move_2 = Move(Geometry=rotate.Geometry, Motion=vec2pt.Vector)  # -> Geometry, Transform
swp1 = Sweep1(Rail=graft(line), Sections=graft(move_2.Geometry), Miter=1)  # -> flatten(Brep)
swp1_2 = Sweep1(Rail=graft(line), Sections=graft(move.Geometry), Miter=1)  # -> flatten(Brep)
clean_2 = CleanTree(RemoveNulls=True, RemoveInvalid=True, RemoveEmpty=False, Tree=swp1)
clean_3 = CleanTree(RemoveNulls=True, RemoveInvalid=True, RemoveEmpty=False, Tree=swp1_2)
cap_2 = CapHoles(Brep=clean_2)
cap_3 = CapHoles(Brep=clean_3)
clean_4 = CleanTree(RemoveNulls=True, RemoveInvalid=True, RemoveEmpty=False, Tree=cap_2)
clean_5 = CleanTree(RemoveNulls=True, RemoveInvalid=True, RemoveEmpty=False, Tree=cap_3)
volume = Volume(Geometry=clean_5)  # -> Volume, Centroid
volume_2 = Volume(Geometry=clean_4)  # -> Volume, Centroid
smaller = SmallerThan(FirstNumber=volume.Volume, SecondNumber=0.01)  # -> SmallerThan, OrEqualTo
smaller_2 = SmallerThan(FirstNumber=volume_2.Volume, SecondNumber=0.01)  # -> SmallerThan, OrEqualTo
dispatch = Dispatch(List=clean_5, DispatchPattern=smaller.SmallerThan)  # -> ListA, ListB
dispatch_2 = Dispatch(List=clean_4, DispatchPattern=smaller_2.SmallerThan)  # -> ListA, ListB
brep = Brep(dispatch.ListB)
brep_2 = Brep(dispatch_2.ListB)
sunion = SolidUnion(Breps=flatten([brep_2, brep, cap]))
mesh = MeshBrep(
    Brep=sunion,
    Settings={GridMaxCount=0, GridMinCount=16, JaggedSeams=False, MaxEdgeLength=0, MinEdgeLength=0.0001, MinTolerance=0, Refine=True, RefineAngle=0, RelativeTolerance=0.65, SimplePlanes=True, Tolerance=0})
